# Grasshopper definition point_cloud.gh (Grasshopper 0.9.76)

altura_cabo_a = Slider(50, range=10..200)
altura_cabo_a_2 = Slider(39, range=10..200)
altura_cabo_a_3 = Slider(31, range=10..200)
dist_centro = Slider(6, range=2..30)
dist_centro_2 = Slider(10, range=2..30)
dist_centro_3 = Slider(10, range=2..30)

altura = Slider(53, range=0..220)
largura_apoios = Slider(5, range=0..60)
n_cabos = Slider(6, range=0..8)
horiz_div = Slider(11, range=2..20)
subdiv = Slider(2, range=1..6)

altura_cabo_a_4 = Slider(73, range=10..200)
dist_centro_4 = Slider(30, range=10..30)
point_cloud = CSharpScript(
    Largura=largura_apoios,
    Altura=altura,
    horiz_div=horiz_div,
    subdiv=subdiv,
    N_cabos=n_cabos,
    dist_centro=[dist_centro, dist_centro_2, dist_centro_3, dist_centro_4],
    h_cabos=[altura_cabo_a, altura_cabo_a_2, altura_cabo_a_3, altura_cabo_a_4])  # -> Debug, Cloud, Arm_pts, connection_rings; inputs Largura: Double, Altura: Int32, horiz_div: Double, subdiv: Double, N_cabos: Int32, dist_centro: list of Int32, h_cabos: list of Int32
# ---------- point_cloud: C# ----------
    List<Point3d> Pt_cloud = new List<Point3d>(); // no programa final usar 2D array !!! [x,y,z]
    List<Point3d> arm_pt_cloud = new List<Point3d>();
    List<Int32> con_ring_set = new List<Int32>();

    int x = 0;
    int y = 1;
    int h = 1;
    bool reverse = false;

    //#######################//
    //Tilt calc + N of rings //
    //#######################//
    double ring_z_step = (Altura) / horiz_div; // ok

    double tilt;
    tilt = (Largura * 0.5) / (Altura) * ring_z_step; //ok

    //##################//
    //main pt cloud loop//
    //##################//

    //Pts apoio
    Pt_cloud.Add(new Point3d(0, 0, 0));
    Pt_cloud.Add(new Point3d(Largura, 0, 0));
    Pt_cloud.Add(new Point3d(Largura, Largura, 0));
    Pt_cloud.Add(new Point3d(0, Largura, 0));

    for(h = 1; h <= horiz_div - 1; h++){ // ring loop

      double scale_factor = (1 - ((-0.04 * h * h + 1.35 * h + 0.7) / horiz_div));
      double step = (-0.04 * h * h + 1.35 * h + 0.7) * tilt;

      if(!reverse){ // x++ y++

        //Altura-((1/(horiz_div*horiz_div))*h*h-2*(1/horiz_div)*h+1)*Altura)

        for(x = 0;x <= subdiv; x++){

          Pt_cloud.Add(new Point3d(step + x * (Largura / subdiv) * scale_factor, step, (-0.04 * h * h + 1.35 * h + 0.7) * ring_z_step));

          if (x == subdiv){

            for(y = 1;y <= subdiv; y++){

              Pt_cloud.Add(new Point3d(Largura - step, step + y * (Largura / subdiv) * scale_factor, (-0.04 * h * h + 1.35 * h + 0.7) * ring_z_step));

              if(x == subdiv && y == subdiv){reverse = true;} // start backwards loop
            }
          }
        }

      }

      if(reverse){ // x-- y--
        for(x = (int) subdiv - 1;x >= 0; x--){
          Pt_cloud.Add(new Point3d(step + x * (Largura / subdiv) * scale_factor, Largura - step, (-0.04 * h * h + 1.35 * h + 0.7) * ring_z_step));

          if (x == 0){
            for(y = (int) subdiv - 1;y >= 1; y--){
              Pt_cloud.Add(new Point3d(step, step + y * (Largura / subdiv) * scale_factor, (-0.04 * h * h + 1.35 * h + 0.7) * ring_z_step));


            }
          }
        }
      }

      reverse = false;
    }

    ///////////////////////////
    //#######################//
    //######## Arms #########//
    //#######################//
    ///////////////////////////


    for(int n = 0;n < (N_cabos / 2);n++){   //for each set of cables

      int init_h = find_nearest(h_cabos[n], horiz_div, ring_z_step); //encontrar os horiz ring + perto
      con_ring_set.Add(init_h);
      double arm_lenght = Math.Abs(dist_centro[n] - (Largura * 0.5 - (-0.04 * init_h * init_h + 1.35 * init_h + 0.7) * tilt));

      //lower arm angle
      double XY_m = (Largura * 0.5 - (-0.04 * init_h * init_h + 1.35 * init_h + 0.7) * tilt) / arm_lenght; //inclinação da reta Y=mx em XY
      double XZ_m = (h_cabos[n] - (-0.04 * init_h * init_h + 1.35 * init_h + 0.7) * ring_z_step) / arm_lenght; //inclinação da reta Z=mx em XZ

      double tpArm_init_h = (-0.04 * (init_h + 1) * (init_h + 1) + 1.35 * (init_h + 1) + 0.7);
      //upper arm angle
      double XY_m_upp = (Largura * 0.5 - (tpArm_init_h) * tilt) / arm_lenght;
      double XZ_m_upp = (h_cabos[n] - (tpArm_init_h) * ring_z_step) / arm_lenght;


      //############//
      //#Right arm#//
      //###########//

      //1st lower arm
      for(int _subdiv = 1;_subdiv <= 5;_subdiv++){ // criar variavel se necessario controlo sobre o refinamento do braço

        double _x = (Largura - (-0.04 * init_h * init_h + 1.35 * init_h + 0.7) * tilt) + (arm_lenght / 5) * _subdiv;

        if(_subdiv == 5){
          arm_pt_cloud.Add(new Point3d(_x, Largura * 0.5, h_cabos[n]));
          break;
        }
        arm_pt_cloud.Add(new Point3d(_x, (-0.04 * init_h * init_h + 1.35 * init_h + 0.7) * tilt + XY_m * (_x - (Largura - (-0.04 * init_h * init_h + 1.35 * init_h + 0.7) * tilt)), (-0.04 * init_h * init_h + 1.35 * init_h + 0.7) * ring_z_step + XZ_m * (_x - (Largura - (-0.04 * init_h * init_h + 1.35 * init_h + 0.7) * tilt))));//1st lower arm
      }

      //2nd lower arm
      for(int _subdiv = 1;_subdiv < 5;_subdiv++){ // nao "<=" para nao criar 2 pts de convergencia
        double _x = (Largura - (-0.04 * init_h * init_h + 1.35 * init_h + 0.7) * tilt) + (arm_lenght / 5) * _subdiv;
        arm_pt_cloud.Add(new Point3d(_x, Largura - (-0.04 * init_h * init_h + 1.35 * init_h + 0.7) * tilt - XY_m * (_x - (Largura - (-0.04 * init_h * init_h + 1.35 * init_h + 0.7) * tilt)), (-0.04 * init_h * init_h + 1.35 * init_h + 0.7) * ring_z_step + XZ_m * (_x - (Largura - (-0.04 * init_h * init_h + 1.35 * init_h + 0.7) * tilt))));
      }

      //1st upper arm
      for(int _subdiv = 1;_subdiv < 5;_subdiv++){ // criar variavel se necessario controlo sobre o refinamento do braço
        double _x = (Largura - (-0.04 * init_h * init_h + 1.35 * init_h + 0.7) * tilt) + (arm_lenght / 5) * _subdiv;

        arm_pt_cloud.Add(new Point3d(_x, (tpArm_init_h) * tilt + XY_m_upp * (_x - (Largura - (-0.04 * init_h * init_h + 1.35 * init_h + 0.7) * tilt)), (tpArm_init_h) * ring_z_step + XZ_m_upp * (_x - (Largura - (-0.04 * init_h * init_h + 1.35 * init_h + 0.7) * tilt))));
      }
      //2nd upper arm
      for(int _subdiv = 1;_subdiv < 5;_subdiv++){ // nao "<=" para nao criar 2 pts de convergencia
        double _x = (Largura - (-0.04 * init_h * init_h + 1.35 * init_h + 0.7) * tilt) + (arm_lenght / 5) * _subdiv;

        arm_pt_cloud.Add(new Point3d(_x, Largura - (tpArm_init_h) * tilt - XY_m_upp * (_x - (Largura - (-0.04 * init_h * init_h + 1.35 * init_h + 0.7) * tilt)), (tpArm_init_h) * ring_z_step + XZ_m_upp * (_x - (Largura - (-0.04 * init_h * init_h + 1.35 * init_h + 0.7) * tilt))));
      }

      //############//
      //##Left arm##//
      //############//

      //left
      //1st lower arm
      for(int _subdiv = 1;_subdiv <= 5;_subdiv++){ // criar variavel se necessario controlo sobre o refinamento do braço

        double _x = ( (-0.04 * init_h * init_h + 1.35 * init_h + 0.7) * tilt) - (arm_lenght / 5) * _subdiv;

        if(_subdiv == 5){
          arm_pt_cloud.Add(new Point3d(_x, Largura * 0.5, h_cabos[n]));
          break;
        }

        arm_pt_cloud.Add(new Point3d(_x, (-0.04 * init_h * init_h + 1.35 * init_h + 0.7) * tilt - XY_m * (_x - (-0.04 * init_h * init_h + 1.35 * init_h + 0.7) * tilt), (-0.04 * init_h * init_h + 1.35 * init_h + 0.7) * ring_z_step - XZ_m * (_x - (-0.04 * init_h * init_h + 1.35 * init_h + 0.7) * tilt)));//1st lower arm
      }

      //2nd lower arm
      for(int _subdiv = 1;_subdiv < 5;_subdiv++){ // nao "<=" para nao criar 2 pts de convergencia
        double _x = ( (-0.04 * init_h * init_h + 1.35 * init_h + 0.7) * tilt) - (arm_lenght / 5) * _subdiv;

        arm_pt_cloud.Add(new Point3d(_x, Largura - (-0.04 * init_h * init_h + 1.35 * init_h + 0.7) * tilt + XY_m * (_x - (-0.04 * init_h * init_h + 1.35 * init_h + 0.7) * tilt), (-0.04 * init_h * init_h + 1.35 * init_h + 0.7) * ring_z_step - XZ_m * (_x - (-0.04 * init_h * init_h + 1.35 * init_h + 0.7) * tilt)));
      }

      //1st upper arm
      for(int _subdiv = 1;_subdiv < 5;_subdiv++){ // criar variavel se necessario controlo sobre o refinamento do braço
        double _x = ((-0.04 * init_h * init_h + 1.35 * init_h + 0.7) * tilt) - (arm_lenght / 5) * _subdiv;

        arm_pt_cloud.Add(new Point3d(_x, (tpArm_init_h) * tilt - XY_m_upp * (_x - (-0.04 * init_h * init_h + 1.35 * init_h + 0.7) * tilt), (tpArm_init_h) * ring_z_step - XZ_m_upp * (_x - (-0.04 * init_h * init_h + 1.35 * init_h + 0.7) * tilt)));
      }
      //2nd upper arm
      for(int _subdiv = 1;_subdiv < 5;_subdiv++){ // nao "<=" para nao criar 2 pts de convergencia
        double _x = ((-0.04 * init_h * init_h + 1.35 * init_h + 0.7) * tilt) - (arm_lenght / 5) * _subdiv;

        arm_pt_cloud.Add(new Point3d(_x, Largura - (tpArm_init_h) * tilt + XY_m_upp * (_x - (-0.04 * init_h * init_h + 1.35 * init_h + 0.7) * tilt), (tpArm_init_h) * ring_z_step - XZ_m_upp * (_x - (-0.04 * init_h * init_h + 1.35 * init_h + 0.7) * tilt)));
      }
    }

    Arm_pts = arm_pt_cloud;
    Cloud = Pt_cloud;
    connection_rings = con_ring_set;
# ---------- point_cloud: C# additional code ----------
  private int find_nearest(int altura, double horiz_div, double ring_z_step){
    int nearest = -1;
    double dist = 10000;

    for (int h = 1; h <= horiz_div - 2; h++){
      if(dist > Math.Abs(altura - (-0.04 * h * h + 1.35 * h + 0.7) * ring_z_step)){
        dist = Math.Abs(altura - (-0.04 * h * h + 1.35 * h + 0.7) * ring_z_step);
        nearest = h;
      }
    }

    return nearest;
  }
# ---------- end point_cloud ----------
panel = Panel(point_cloud.connection_rings)
generate_bars = CSharpScript(
    Cloud=point_cloud.Cloud,
    subdiv=subdiv,
    horiz_div=horiz_div,
    Arm_pts=point_cloud.Arm_pts,
    connection_rings=point_cloud.connection_rings,
    N_cabos=n_cabos)  # -> Debug, bars; inputs Cloud: list of Point3d, subdiv: Int32, horiz_div: Int32, Arm_pts: list of Point3d, connection_rings: list of Int32, N_cabos: Int32
# ---------- generate_bars: C# ----------
    List<Line> Lines = new List<Line>();
    //
    //Connect support pts
    //
    //add Lcr
    for(int i = 0; i <= 4;i++){

      if (i == 0){
        for (int j = 4;j <= 4 + subdiv;j++){

          if(j == 4){
            Lines.Add(new Line(Cloud[0], Cloud[j]));
          }
          else{ Lines.Add(new Line(Cloud[0], Cloud[j]));
          }

        }
        for (int j = 8 + 4 * (subdiv - 1) - 1;j >= 8 + 4 * (subdiv - 1) - subdiv;j--){
          Lines.Add(new Line(Cloud[0], Cloud[j]));
        }

      }
      if (i == 1){
        for (int j = 4;j <= 4 + 2 * subdiv;j++){

          if(j == 4 + subdiv){
            Lines.Add(new Line(Cloud[1], Cloud[j]));
          }else{
            Lines.Add(new Line(Cloud[1], Cloud[j]));
          }
        }
      }
      if (i == 2){
        for (int j = 4 + subdiv;j <= 4 + 3 * subdiv;j++){
          if(j == 4 + 2 * subdiv){
            Lines.Add(new Line(Cloud[2], Cloud[j]));
          }else{
            Lines.Add(new Line(Cloud[2], Cloud[j]));
          }
        }
      }
      if (i == 3){
        for (int j = 4 + subdiv * 2;j <= 4 + 4 * subdiv - 1;j++){
          if(j == 4 + 3 * subdiv){
            Lines.Add(new Line(Cloud[3], Cloud[j]));
          }else{
            Lines.Add(new Line(Cloud[3], Cloud[j]));
          }
        }
        Lines.Add(new Line(Cloud[3], Cloud[4]));
      }
    }

    //Connect all other points
    //add Lcr nesta fase !!!
    int ring_pt = 4 + (subdiv - 1) * 4;
    //init and end pts
    for(int h = 0; h <= horiz_div - 3;h++){

      // Lado +XX
      for(int i = 4 + ring_pt * h;i < 4 + ring_pt * (h + 1);i++){//init coord.
        //lados
        if(i == 4 + ring_pt * h){//cantos
          for(int j = 4 + ring_pt * (h + 1);j <= subdiv + 4 + ring_pt * (h + 1) - 1;j++){ //-1 para nao conectar a diagonal oposta
            if(j == 4 + ring_pt * (h + 1)){
              Lines.Add(new Line(Cloud[i], Cloud[j])); //barra que nao pode desaparecer
            }else{
              Lines.Add(new Line(Cloud[i], Cloud[j]));
            }

          }
        }else if(i == 4 + ring_pt * h + subdiv){
          for(int j = 4 + ring_pt * (h + 1) + 1;j <= subdiv + 4 + ring_pt * (h + 1) - 1;j++){ //+1 para nao conectar a diagonal oposta
            Lines.Add(new Line(Cloud[i], Cloud[j])); //quando i = j-ring_pt  id bar as active(always)
          }
        }else{ //pts centrais
          if(i > 4 + ring_pt * h && i < 4 + ring_pt * h + subdiv){
            for(int j = 4 + ring_pt * (h + 1);j <= subdiv + 4 + ring_pt * (h + 1);j++){
              Lines.Add(new Line(Cloud[i], Cloud[j]));
            }
          }
        }
      }
      // Lado +YY
      for(int i = 4 + subdiv + ring_pt * h;i < 4 + subdiv + ring_pt * (h + 1);i++){//init coord.

        //lados
        if(i == 4 + subdiv + ring_pt * h){//cantos
          for(int j = 4 + subdiv + ring_pt * (h + 1);j <= 2 * subdiv + 4 + ring_pt * (h + 1) - 1;j++){

            if(j == 1 * subdiv + 4 + ring_pt * (h + 1)){
              Lines.Add(new Line(Cloud[i], Cloud[j])); //canto nao desactiva
            }else{
              Lines.Add(new Line(Cloud[i], Cloud[j]));
            }
          }
        }else if(i == 4 + ring_pt * h + 2 * subdiv){
          for(int j = 4 + subdiv + ring_pt * (h + 1) + 1;j <= 2 * subdiv + 4 + ring_pt * (h + 1) - 1;j++){
            Lines.Add(new Line(Cloud[i], Cloud[j]));
          }

        }else{ //pts centrais
          if(i > 4 + subdiv + ring_pt * h && i < 4 + ring_pt * h + 2 * subdiv){
            for(int j = 4 + subdiv + ring_pt * (h + 1);j <= 2 * subdiv + 4 + ring_pt * (h + 1);j++){
              Lines.Add(new Line(Cloud[i], Cloud[j]));
            }
          }
        }
      }

      // Lado -XX
      for(int i = 4 + 2 * subdiv + ring_pt * h;i < 4 + 2 * subdiv + ring_pt * (h + 1);i++){//init coord.
        //lados
        if(i == 4 + 2 * subdiv + ring_pt * h){//cantos
          for(int j = 4 + 2 * subdiv + ring_pt * (h + 1);j <= 3 * subdiv + 4 + ring_pt * (h + 1) - 1;j++){
            if(j == 2 * subdiv + 4 + ring_pt * (h + 1)){
              Lines.Add(new Line(Cloud[i], Cloud[j])); //canto nao desactiva
            }else{
              Lines.Add(new Line(Cloud[i], Cloud[j]));
            }
          }
        }else if(i == 4 + ring_pt * h + 3 * subdiv){
          for(int j = 4 + 2 * subdiv + ring_pt * (h + 1) + 1;j <= 3 * subdiv + 4 + ring_pt * (h + 1) - 1;j++){
            Lines.Add(new Line(Cloud[i], Cloud[j]));
          }
        }else{ //pts centrais
          if(i > 4 + 2 * subdiv + ring_pt * h && i < 4 + ring_pt * h + 3 * subdiv){
            for(int j = 4 + 2 * subdiv + ring_pt * (h + 1);j <= 3 * subdiv + 4 + ring_pt * (h + 1);j++){
              Lines.Add(new Line(Cloud[i], Cloud[j]));
            }
          }
        }
      }

      // Lado -YY
      for(int i = 4 + 3 * subdiv + ring_pt * h;i < 4 + 3 * subdiv + ring_pt * (h + 1);i++){//init coord.
        //lados
        if(i == 4 + 3 * subdiv + ring_pt * h){//cantos
          for(int j = 4 + 3 * subdiv + ring_pt * (h + 1);j <= 4 * subdiv + 4 + ring_pt * (h + 1) - 1;j++){
            if(j == 3 * subdiv + 4 + ring_pt * (h + 1)){
              Lines.Add(new Line(Cloud[i], Cloud[j])); //canto nao desactiva
            }else{
              Lines.Add(new Line(Cloud[i], Cloud[j]));
            }

            if(j != 4 + 3 * subdiv + ring_pt * (h + 1)){ //exceto lado oposto
              Lines.Add(new Line(Cloud[4 + ring_pt * h], Cloud[j]));
            } //conect first corner w/ side -YY

          }
        }else{ //pts centrais
          if(i > 4 + 3 * subdiv + ring_pt * h && i < 4 + ring_pt * h + 4 * subdiv){
            for(int j = 4 + 3 * subdiv + ring_pt * (h + 1);j <= 4 * subdiv + 4 + ring_pt * (h + 1) - 1;j++){
              Lines.Add(new Line(Cloud[i], Cloud[j]));
            }
            //Lines.Add(new Line(Cloud[i], Cloud[4 + ring_pt * (h + 1)])); //conect to init pt
          }
        }
      }

    }

    // Horizontal connections
    //add Lcr nesta fase!!!

    for(int h = 0; h <= horiz_div - 2;h++){
      for(int i = 4 + h * ring_pt;i < 4 + (h + 1) * ring_pt - 1;i++){
         //barras que nao podem desaparecer mas podem ter sec min
        if( i == (4 + h * ring_pt) || i == (4 + h * ring_pt + subdiv) || i == 4 + h * ring_pt + 2 * subdiv || i == 4 + h * ring_pt + 3 * subdiv){
          Lines.Add(new Line(Cloud[i], Cloud[i + 1]));
        }
        else if(i + 1 == (4 + h * ring_pt) || i + 1 == (4 + h * ring_pt + subdiv) || i + 1 == 4 + h * ring_pt + 2 * subdiv || i + 1 == 4 + h * ring_pt + 3 * subdiv){
          Lines.Add(new Line(Cloud[i], Cloud[i + 1]));
        }else{
          //todas as barras que podem ser otimizadas e desaparecer
          //Lines.Add(new Line(Cloud[i], Cloud[i + 1]));
        }

        if(i == 4 + (h+1) * ring_pt- 1/*4 + h * ring_pt*/){
          //Lines.Add(new Line(Cloud[i + 4 * subdiv - 1], Cloud[i]));
          Lines.Add(new Line(Cloud[i+1], Cloud[4 + h * ring_pt]));
        }
      }
    }

    //trapered edges
    for(int h = 0; h <= horiz_div - 2;h++){ //percorrer altura
      for(int i = 4 + h * ring_pt + 1;i < 4 + (h + 1) * ring_pt - 1;i++){
      // barras que nao podem desaparecer
        if(i == 4 + h * ring_pt + 1){
        Lines.Add(new Line(Cloud[i], Cloud[5 + (h + 1) * ring_pt - 2]));
        }
        if(i == 4 + h * ring_pt + subdiv - 1){
        Lines.Add(new Line(Cloud[i], Cloud[i + 2]));
        }
        if(i == 4 + h * ring_pt + 2 * subdiv - 1){
        Lines.Add(new Line(Cloud[i], Cloud[i + 2]));
        }
        if(i == 4 + h * ring_pt + 3 * subdiv - 1){
        Lines.Add(new Line(Cloud[i], Cloud[i + 2]));
        }
      }
    }
    //
    //for the triangulation
    for(int h = 0; h <= (int) horiz_div - 3;h++){
      Lines.Add(new Line(Cloud[5 + ring_pt * h], Cloud[3 + (h + 2) * ring_pt]));
      Lines.Add(new Line(Cloud[3 + subdiv + ring_pt * h], Cloud[3 + (subdiv + 2) + ring_pt * (h + 1)]));
      Lines.Add(new Line(Cloud[5 + 2 * subdiv + ring_pt * h], Cloud[3 + 2 * subdiv + ring_pt * (h + 1)]));
      Lines.Add(new Line(Cloud[3 + 3 * subdiv + ring_pt * h], Cloud[5 + 3 * subdiv + (h + 1) * ring_pt]));
    }


    //Lines
    Lines = arm_bars(ref Lines, Arm_pts, connection_rings, Cloud, subdiv, N_cabos);
    bars = Lines;
# ---------- generate_bars: C# additional code ----------
  private List<Line> arm_bars(ref List<Line> Lines, List<Point3d> arm_cld, List<int> connection_rings, List<Point3d> Cloud, int sub, int n_cabos){
    List<Line> _tempLines = new List<Line>();
    //a*34 é o incremento para mudar de conjunto de braços
    for (int a = 0;a < n_cabos / 2;a++){
      for (int i = 0;i <= 2;i++){
        if(i == 0){
          // connect w/ tower

          //Lower right
          Lines.Add(new Line(Cloud[4 + (4 + (sub - 1) * 4) * (connection_rings[0 + a] - 1) + sub], arm_cld[i + a * 34]));
          Lines.Add(new Line(Cloud[4 + (4 + (sub - 1) * 4) * (connection_rings[0 + a] - 1) + 2 * sub], arm_cld[5 + a * 34]));
          //Upper right
          Lines.Add(new Line(Cloud[4 + (4 + (sub - 1) * 4) * (connection_rings[0 + a] ) + sub], arm_cld[i + 9 + a * 34]));
          Lines.Add(new Line(Cloud[4 + (4 + (sub - 1) * 4) * (connection_rings[0 + a] ) + 2 * sub], arm_cld[i + 13 + a * 34]));

          //Lower left
          Lines.Add(new Line(Cloud[4 + (4 + (sub - 1) * 4) * (connection_rings[0 + a] - 1)], arm_cld[i + 17 + a * 34]));
          Lines.Add(new Line(Cloud[4 + (4 + (sub - 1) * 4) * (connection_rings[0 + a] - 1) + 3 * sub], arm_cld[i + 17 + 5 + a * 34]));
          //Upper left
          Lines.Add(new Line(Cloud[4 + (4 + (sub - 1) * 4) * (connection_rings[0 + a] )], arm_cld[i + 26 + a * 34]));
          Lines.Add(new Line(Cloud[4 + (4 + (sub - 1) * 4) * (connection_rings[0 + a] ) + 3 * sub], arm_cld[i + 17 + 5 + 8 + a * 34]));

          //Diagonals
          //1st plane right
          Lines.Add(new Line(Cloud[4 + (4 + (sub - 1) * 4) * (connection_rings[0 + a] - 1) + sub], arm_cld[9 + a * 34]));
          //1st plane left
          Lines.Add(new Line(Cloud[4 + (4 + (sub - 1) * 4) * (connection_rings[0 + a] - 1)], arm_cld[26 + a * 34]));

          //2nd plane right
          Lines.Add(new Line(Cloud[4 + (4 + (sub - 1) * 4) * (connection_rings[0 + a] - 1) + 2 * sub], arm_cld[13 + a * 34]));
          //2nd plane left
          Lines.Add(new Line(Cloud[4 + (4 + (sub - 1) * 4) * (connection_rings[0 + a] - 1) + 3 * sub], arm_cld[30 + a * 34]));


        }

        //diagonals 1st plane right
        Lines.Add(new Line(arm_cld[i + a * 34], arm_cld[10 + i + a * 34]));
        Lines.Add(new Line(arm_cld[i + a * 34], arm_cld[9 + i + a * 34]));
        //diagonals 1st plane left
        Lines.Add(new Line(arm_cld[17 + i + a * 34], arm_cld[27 + i + a * 34]));
        Lines.Add(new Line(arm_cld[17 + i + a * 34], arm_cld[26 + i + a * 34]));

        //diagonals 2nd plane right
        Lines.Add(new Line(arm_cld[5 + i + a * 34], arm_cld[14 + i + a * 34]));
        Lines.Add(new Line(arm_cld[5 + i + a * 34], arm_cld[13 + i + a * 34]));
        //diagonals 2nd plane left
        Lines.Add(new Line(arm_cld[22 + i + a * 34], arm_cld[31 + i + a * 34]));
        Lines.Add(new Line(arm_cld[22 + i + a * 34], arm_cld[30 + i + a * 34]));

        //1st lower chord
        //right
        Lines.Add(new Line(arm_cld[i + a * 34], arm_cld[i + 1 + a * 34]));
        //left
        Lines.Add(new Line(arm_cld[17 + i + a * 34], arm_cld[18 + i + a * 34]));

        //2nd lower chord
        //right
        Lines.Add(new Line(arm_cld[5 + i + a * 34], arm_cld[6 + i + a * 34]));
        //left
        Lines.Add(new Line(arm_cld[22 + i + a * 34], arm_cld[23 + i + a * 34]));

        //1st upper chord
        //right
        Lines.Add(new Line(arm_cld[i + 9 + a * 34], arm_cld[i + 10 + a * 34]));
        //left
        Lines.Add(new Line(arm_cld[i + 26 + a * 34], arm_cld[i + 27 + a * 34]));

        //2nd upper chord

        Lines.Add(new Line(arm_cld[13 + i + a * 34], arm_cld[14 + i + a * 34]));
        Lines.Add(new Line(arm_cld[30 + i + a * 34], arm_cld[31 + i + a * 34]));

        //end lines
        if(i == 2){
          //1nd lower chord
          //right
          Lines.Add(new Line(arm_cld[i + 1 + a * 34], arm_cld[i + 2 + a * 34]));
          //left
          Lines.Add(new Line(arm_cld[18 + i + a * 34], arm_cld[19 + i + a * 34]));

          //2nd lower chord
          //right
          Lines.Add(new Line(arm_cld[6 + i + a * 34], arm_cld[4 + a * 34]));
          //left
          Lines.Add(new Line(arm_cld[23 + i + a * 34], arm_cld[21 + a * 34]));

          //1st upper chord
          //right
          Lines.Add(new Line(arm_cld[10 + i + a * 34], arm_cld[4 + a * 34]));
          //left
          Lines.Add(new Line(arm_cld[27 + i + a * 34], arm_cld[21 + a * 34]));

          //2nd upper chord
          //right
          Lines.Add(new Line(arm_cld[14 + i + a * 34], arm_cld[4 + a * 34]));
          //left
          Lines.Add(new Line(arm_cld[31 + i + a * 34], arm_cld[21 + a * 34]));

          //Diagonals
          //1st plane right
          Lines.Add(new Line(arm_cld[i + 1 + a * 34], arm_cld[10 + i + a * 34]));
          //1st plane left
          Lines.Add(new Line(arm_cld[18 + i + a * 34], arm_cld[27 + i + a * 34]));
          //2nd plane right
          Lines.Add(new Line(arm_cld[i + 6 + a * 34], arm_cld[14 + i + a * 34]));
          //2nd plane left
          Lines.Add(new Line(arm_cld[23 + i + a * 34], arm_cld[31 + i + a * 34]));
        }
      }


    }
    return Lines;
  }
# ---------- end generate_bars ----------
panel_2 = Panel(point_cloud.Cloud)
panel_3 = Panel(generate_bars.bars)
